# Grasshopper definition dfCutFillInPath.gh (Grasshopper 1.0.7)
# plug-ins: Docofossor

# set to: /examples/example_DTM.xyz
path = FilePath()
dfimportxyz = ImportXYZ(MarshallingSignalParameter=path)
crv = Curve()
dfcutfillinpath = CutFillInPath(Df=dfimportxyz, Crv=crv, W="5")  # -> Df, Vol
dfgridmesh = GridMesh(Df=dfcutfillinpath.Df)
